# Grasshopper definition test.ghx (Grasshopper 1.0.7)
# plug-ins: prop2node

# ---- group: ПБ
делит_пб_отсек = Text()
огнестокость = Text()
set_name = Prop2node(ИмяПараметра=делит_пб_отсек)
set_name_2 = Prop2node(ИмяПараметра=огнестокость)

# ---- group: Классификация
классификация = Text()
set_name_3 = Prop2node(ИмяПараметра=классификация)

# ----
_01_01_стена = Text()
equals = Equality(FirstNumber=set_name_3, SecondNumber=_01_01_стена)  # -> Equality, Inequality
да = Text()
if = Prop2node(Param_name=set_name_2, Условие=equals.Equality)  # -> Ifyes, Ifno
equals_2 = Equality(FirstNumber=set_name, SecondNumber=да)  # -> Equality, Inequality
if_2 = Prop2node(Param_name=if.Ifno, Условие=equals_2.Equality)  # -> Ifyes, Ifno
_150 = Text(if.Ifyes)
_150_2 = Text(if_2.Ifyes)
rezult = Prop2node(ИмяПараметра=set_name_2, Input=_150)
rezult_2 = Prop2node(ИмяПараметра=set_name_2, Input=_150_2)
